# Dynamo graph modelcleanup.dyn "modelcleanup_Rvt2021_Test_210524" (Dynamo 2.0.3.8810)

# group: USER INPUTS
# note: USED:
# FOR USER SELECTIONS, SETTINGS AND GRAPH VARIABLES

# group: CREATE IN REVIT
# note: USED:
# FOR THE CREATION OF ELEMENTS IN THE REVIT WORKSPACE

# group: GET DATA
# note: USED:
# FOR THE DISCOVERY AND RETRIVAL OF INFORMATION

# group: WRITE DATA
# note: USED:
# FOR INSTANCES WHICH CREATE  AND EXPORT DATA TO REVIT OR EXTERNAL SOFTWARES/DIRECTORIES

# group: GRAPH PROCESS COLOR CODING
# note: DYNAMO GRAPHIC STANDARDS APPLIED

# group: CREATE IN DYNAMO
# note: USED:
# IN CREATION OR ADAPTATION OF GEOMETRY IN THE DYNAMO WORKSPACE

# group: PROCESS DATA
# note: USED:
# AS A GENERAL DEFINITION FOR CASES OF DATA PROCESSING

# group: Usage Notes
# note: Script Version: 1.1
# Dynamo Version: 2.0.0+
# Author: Paul Fassnidge
# Date: 24/05/2021
# Contact: paulfassnidge@hydrock.com
# Released Notes:
# Fit Revit 2021 API Change to Delete() Method
# Packages Used:
# Data-Shapes version: 2019.2.42

# group: UI Select +
code_block = CodeBlock { "BPE Model Purge Tool"; }
file_path = Filename("..\..\..\OneDrive - Hydrock Consultants Ltd\BPE_Labs\bpe_labs.jpg")
code_block_2 = CodeBlock { "Delete (Are you sure?!)"; }
code_block_3 = CodeBlock { "What do you want to Purge from the Model? Please make sure this is the right model and you have sync'd to Central first!"; }
code_block_4 = CodeBlock { false; }
code_block_5 = CodeBlock { "Delete Views and Sheets"; }
data_shapes_ui_boolean_input = Custom[Data-Shapes_UI.Boolean input](InputName=code_block_3, DefaultValue=code_block_4, SideText=code_block_5)  # Creates a boolean input for UI.MultipleInputForm ++ . Check out www.data-shapes.net for more infos!
code_block_6 = CodeBlock { false; }
code_block_7 = CodeBlock { "Delete Schedules"; }
data_shapes_ui_boolean_input_2 = Custom[Data-Shapes_UI.Boolean input](DefaultValue=code_block_6, SideText=code_block_7)
code_block_8 = CodeBlock { false; }
code_block_9 = CodeBlock { "Unload Links"; }
data_shapes_ui_boolean_input_3 = Custom[Data-Shapes_UI.Boolean input](DefaultValue=code_block_8, SideText=code_block_9)
list_create = List.Create(item0=data_shapes_ui_boolean_input, item1=data_shapes_ui_boolean_input_2, item2=data_shapes_ui_boolean_input_3)
code_block_10 = CodeBlock { true; }
code_block_11 = CodeBlock { "Cancel"; }
code_block_12 = CodeBlock { 800; }
data_shapes_ui_multipleinputform = Custom[Data-Shapes_UI.MultipleInputForm ++](Description_optional=code_block, Logo_optional=file_path, ButtonText_optional=code_block_2, Inputs=list_create, Toggle=code_block_10, CancelButtonText_optional=code_block_11, MaxHeight_optional=code_block_12, Width_optional=code_block_12)  # Create a form with multiple inputs. see www.data-shapes.net for tutorials and infos!

# group: Sort data
code_block_13 = CodeBlock { 0; }
getItemAtIndex = List.GetItemAtIndex(list=data_shapes_ui_multipleinputform.User_Inputs, index=code_block_13)
code_block_14 = CodeBlock { 1; }
getItemAtIndex_2 = List.GetItemAtIndex(list=data_shapes_ui_multipleinputform.User_Inputs, index=code_block_14)
code_block_15 = CodeBlock { 2; }
getItemAtIndex_3 = List.GetItemAtIndex(list=data_shapes_ui_multipleinputform.User_Inputs, index=code_block_15)

# group: Get Items
get_document = Python()
# ---------- get_document.python (29 lines) ----------
# Copyright(c) 2015, Konrad K Sobon
# @arch_laboratory, http://archi-lab.net

# Import DocumentManager
import clr
clr.AddReference("RevitServices")
import RevitServices
from RevitServices.Persistence import DocumentManager

import sys
pyt_path = r'C:\Program Files (x86)\IronPython 2.7\Lib'
sys.path.append(pyt_path)

#The inputs to this node will be stored as a list in the IN variable.
dataEnteringNode = IN

try:
	errorReport = None
	doc = DocumentManager.Instance.CurrentDBDocument
except:
	# if error accurs anywhere in the process catch it
	import traceback
	errorReport = traceback.format_exc()

#Assign your output to the OUT variable
if errorReport == None:
	OUT = doc
else:
	OUT = errorReport
# ----------------------------------------
get_all_views_sheets = Python(IN[0]=get_document)
# ---------- get_all_views_sheets.python (24 lines) ----------
import clr
clr.AddReference('RevitAPI')
from Autodesk.Revit.DB import *
import Autodesk

clr.AddReference("RevitServices")
import RevitServices
from RevitServices.Persistence import DocumentManager

inputdoc = UnwrapElement(IN[0])
if inputdoc == None:
	doc = DocumentManager.Instance.CurrentDBDocument
elif inputdoc.GetType().ToString() == "Autodesk.Revit.DB.RevitLinkInstance":
	doc = inputdoc.GetLinkDocument()
elif inputdoc.GetType().ToString() == "Autodesk.Revit.DB.Document":
	doc = inputdoc
else: doc = None

collector = FilteredElementCollector(doc)
views = collector.OfClass(View).ToElements()
viewlist = list()
for view in views:
	viewlist.append(view)
OUT = viewlist
# ----------------------------------------
flatten = List.Flatten(list=get_all_views_sheets)
restOfItems = List.RestOfItems(list=flatten)
get_project_documents = Python()  # graph input
# ---------- get_project_documents.python (100 lines) ----------
#Copyright(c) 2015, Konrad Sobon
# @arch_laboratory, http://archi-lab.net

import clr
clr.AddReference('ProtoGeometry')
from Autodesk.DesignScript.Geometry import *

# Import DocumentManager and TransactionManager
clr.AddReference("RevitServices")
import RevitServices
from RevitServices.Persistence import DocumentManager
from RevitServices.Transactions import TransactionManager

# Import RevitAPI
clr.AddReference("RevitAPI")
import Autodesk
from Autodesk.Revit.DB import *

doc = DocumentManager.Instance.CurrentDBDocument
uiapp = DocumentManager.Instance.CurrentUIApplication
app = uiapp.Application

from System.Collections.Generic import *

# Import ToDSType(bool) extension method
clr.AddReference("RevitNodes")
import Revit
clr.ImportExtensions(Revit.Elements)

#The inputs to this node will be stored as a list in the IN variable.
dataEnteringNode = IN

#collect all views in the model
collector = FilteredElementCollector(doc)
views = collector.OfClass(View).ToElements()

#sort views into separate lists based on view type
areaPlans, ceilingPlans, columnSchedules = [], [], []
costReport, details, draftingViews = [], [], []
drawingSheets, elevations, engineetingPlans = [], [], []
floorPlans, internal, legends, loadReports = [], [], [], []
panelSchedules, pressureLossReports, renderings = [], [], []
reports, schedules, sections, threeD = [], [], [], []
undefined, walkthrough = [], []
for i in views:
	if not i.IsTemplate:
		if i.ViewType == ViewType.AreaPlan:
			areaPlans.append(i.ToDSType(True))
		elif i.ViewType == ViewType.CeilingPlan:
			ceilingPlans.append(i.ToDSType(True))
		elif i.ViewType == ViewType.ColumnSchedule:
			columnSchedules.append(i.ToDSType(True))
		elif i.ViewType == ViewType.CostReport:
			costReport.append(i.ToDSType(True))
		elif i.ViewType == ViewType.Detail:
			details.append(i.ToDSType(True))
		elif i.ViewType == ViewType.DraftingView:
			draftingViews.append(i.ToDSType(True))
		elif i.ViewType == ViewType.DrawingSheet:
			drawingSheets.append(i.ToDSType(True))
		elif i.ViewType == ViewType.Elevation:
			elevations.append(i.ToDSType(True))
		elif i.ViewType == ViewType.EngineeringPlan:
			engineetingPlans.append(i.ToDSType(True))
		elif i.ViewType == ViewType.FloorPlan:
			floorPlans.append(i.ToDSType(True))
		elif i.ViewType == ViewType.Internal:
			internal.append(i.ToDSType(True))
		elif i.ViewType == ViewType.Legend:
			legends.append(i.ToDSType(True))
		elif i.ViewType == ViewType.LoadsReport:
			loadReports.append(i.ToDSType(True))
		elif i.ViewType == ViewType.PanelSchedule:
			panelSchedules.append(i.ToDSType(True))
		elif i.ViewType == ViewType.PresureLossReport:
			pressureLossReports.append(i.ToDSType(True))
		elif i.ViewType == ViewType.Rendering:
			renderings.append(i.ToDSType(True))
		elif i.ViewType == ViewType.Report:
			reports.append(i.ToDSType(True))
		elif i.ViewType == ViewType.Schedule:
			schedules.append(i.ToDSType(True))
		elif i.ViewType == ViewType.Section:
			sections.append(i.ToDSType(True))
		elif i.ViewType == ViewType.ThreeD:
			threeD.append(i.ToDSType(True))
		elif i.ViewType == ViewType.Undefined:
			undefined.append(i.ToDSType(True))
		elif i.ViewType == ViewType.Walkthrough:
			walkthrough.append(i.ToDSType(True))
		else:
			continue

#Assign your output to the OUT variable
OUT = areaPlans, ceilingPlans, columnSchedules, costReport, \
	details, draftingViews, drawingSheets, elevations, \
	engineetingPlans, floorPlans, internal, legends, \
	loadReports, panelSchedules, pressureLossReports, \
	renderings, reports, schedules, sections, threeD, \
	undefined, walkthrough
# ----------------------------------------
code_block_16 = CodeBlock { 17; }
getItemAtIndex_4 = List.GetItemAtIndex(list=get_project_documents, index=code_block_16)
get_link_instances = Python()  # unwired: IN[0]
# ---------- get_link_instances.python (10 lines) ----------
import clr
clr.AddReference('RevitAPI')
from Autodesk.Revit.DB import*

clr.AddReference('RevitServices')
from RevitServices.Persistence import DocumentManager

doc = DocumentManager.Instance.CurrentDBDocument

OUT = FilteredElementCollector(doc).OfClass(RevitLinkInstance).ToElements()
# ----------------------------------------

# group: Check and Delete
code_block_17 = CodeBlock { false; }
if_ = If(test=getItemAtIndex, true=restOfItems, false=code_block_17)
code_block_18 = CodeBlock(input=if_) { _input: var[]; }
clean = Python(IN[0]=code_block_18)
# ---------- clean.python (23 lines) ----------
#Copyright(c) 2015, Konrad K Sobon
# @arch_laboratory, http://archi-lab.net

import clr
clr.AddReference('ProtoGeometry')
from Autodesk.DesignScript.Geometry import *
#The inputs to this node will be stored as a list in the IN variable.
dataEnteringNode = IN

def ClearList(_list):
    out = []
    for _list1 in _list:
        if _list1 is None:
            continue
        if isinstance(_list1, list):
             _list1 = ClearList(_list1)
             if not _list1:
                 continue
        out.append(_list1)
    return out

#Assign your output to the OUT variable
OUT = ClearList(IN[0])
# ----------------------------------------
code_block_19 = CodeBlock(out=clean) { _out; }
delete = Python(IN[0]=code_block_19)
# ---------- delete.python (47 lines) ----------
#python nodes in dynamo 1.0
#proposed by Julien Benoit @jbenoit44 
#http://aecuandme.wordpress.com/
import clr
clr.AddReference('ProtoGeometry')
from Autodesk.DesignScript.Geometry import *
# Import ToDSType(bool) extension method
clr.AddReference("RevitNodes")
import Revit
clr.ImportExtensions(Revit.Elements)
# Import geometry conversion extension methods
clr.ImportExtensions(Revit.GeometryConversion)
# Import DocumentManager and TransactionManager
clr.AddReference("RevitServices")
import RevitServices
from RevitServices.Persistence import DocumentManager
from RevitServices.Transactions import TransactionManager
from System.Collections.Generic import *
# Import RevitAPI
clr.AddReference("RevitAPI")
import Autodesk
from Autodesk.Revit.DB import *

doc = DocumentManager.Instance.CurrentDBDocument
uiapp = DocumentManager.Instance.CurrentUIApplication
app = uiapp.Application

elt = []
for i in IN[0]:
	elt.append(UnwrapElement(i).Id)

# Start Transaction
TransactionManager.Instance.EnsureInTransaction(doc)


cantdelete=[]
for item in elt:
	try:
		doc.Delete(item)
	except:
		cantdelete.append(item)
		

# End Transaction
TransactionManager.Instance.TransactionTaskDone()
doc.Regenerate()
OUT=cantdelete
# ----------------------------------------
if_2 = If(test=getItemAtIndex_2, true=getItemAtIndex_4, false=code_block_17)
code_block_20 = CodeBlock(input=if_2) { _input: var[]; }
clean_2 = Python(IN[0]=code_block_20)  # same code as clean
code_block_21 = CodeBlock(out=clean_2) { _out; }
delete_2 = Python(IN[0]=code_block_21)  # same code as delete
if_3 = If(test=getItemAtIndex_3, true=get_link_instances, false=code_block_17)
unload_links = Python(IN[0]=if_3)
# ---------- unload_links.python (31 lines) ----------
import clr
clr.AddReference('RevitAPI')
import Autodesk
from Autodesk.Revit.DB import *
from Autodesk.Revit.Attributes import*

clr.AddReference("RevitServices")
import RevitServices
from RevitServices.Persistence import DocumentManager
from RevitServices.Transactions import TransactionManager

clr.AddReference("RevitNodes")
import Revit
clr.ImportExtensions(Revit.Elements)


dataEnteringNode = IN

doc = DocumentManager.Instance.CurrentDBDocument

revitlinktypes=list()
linkcollector=FilteredElementCollector(doc).OfClass(RevitLinkInstance)
revitlinktypes=[]
TransactionManager.Instance.ForceCloseTransaction()
for rli in linkcollector:
	rlt=doc.GetElement(rli.GetTypeId())
	revitlinktypes.append(rlt)
	rlt.Unload(None)
	

OUT= 0
# ----------------------------------------

# group: Analytics
log_start_time = Python()  # unwired: IN[0]
# ---------- log_start_time.python (21 lines) ----------
#BPE data metrics by PF

import clr
import System
from System.IO import Directory

import sys
# load python
pyt_path = r'C:\Program Files (x86)\IronPython 2.7\Lib'
sys.path.append(pyt_path)

from datetime import datetime

project = IN[0]

# get the current date and time
starttime = datetime.now().strftime("%H-%M-%S")

import os

OUT = starttime
# ----------------------------------------
control = CodeBlock(passthrough=delete, waitfor=log_start_time) { [passthrough,waitfor][0]; }
python_script = Python(IN[0]=control, IN[1]=log_start_time)  # frozen
# ---------- python_script.python (66 lines) ----------
#HDT data analytics by PF

import clr
import sys

clr.AddReference("RevitServices")
clr.AddReference('DynamoRevitDS')
import RevitServices
from RevitServices.Persistence import DocumentManager

pyt_path = r'C:\Program Files (x86)\IronPython 2.7\Lib'
sys.path.append(pyt_path)

import clr
import System
import sys
import Dynamo 
import os

from System.IO import Directory
from System import Environment

DynamoRevit=Dynamo.Applications.DynamoRevit()

from datetime import datetime

#Get doc and dynamo stuff
doc = DocumentManager.Instance.CurrentDBDocument
app = DocumentManager.Instance.CurrentUIApplication.Application
scriptname=DynamoRevit.RevitDynamoModel.CurrentWorkspace.FileName

name=os.path.basename(scriptname)
filename,extention=os.path.splitext(name)
projinfo = doc.ProjectInformation

passthrough = IN[0]
starttime = IN[1]

project = projinfo.Name
number = projinfo.Number
scriptname = filename

starttime = IN[1]
user = Environment.UserName;

# get the current date and time
datestamp = datetime.today().strftime("%Y-%m-%d")
endtime = datetime.now().strftime("%H-%M-%S")

dir = r'C:\Users\{}\Hydrock Consultants Ltd\BIM - Documents\03 Hydrock BIM Standards and Templates\07 Automation\Analytics'.format(user)
dirQ = r'Q:\Office\IT Software\Dynamo\data'

# create a directory
Directory.CreateDirectory(dir)
Directory.CreateDirectory(dirQ)

# generate the file name
filename = (str(datestamp) + '_' +str(endtime) + '_' +str(project) + '_' +str(number) + '_' +str(scriptname) + '_' +str(starttime) + '_' +str(user) + '_' + '.txt')

filenameQ = (str(datestamp) + '_' +str(endtime) + '_' +str(project) + '_' +str(number) + '_' +str(scriptname) + '_' +str(starttime) + '_' +str(user) + '_' + '.txt')

# create the log file
logger = open(dir + '\\' + filename,'w+')
loggerQ = open(dirQ + '\\' + filenameQ,'w+')

OUT = str("Dynamo Analytics Complete")
# ----------------------------------------

get_link_doc = Python(IN[0]=if_3)
# ---------- get_link_doc.python (11 lines) ----------
import clr

#Import the Revit API
clr.AddReference('RevitAPI')
import Autodesk
from Autodesk.Revit.DB import *

eleDoc = UnwrapElement(IN[0]).GetLinkDocument()

#To get the doc:
OUT = eleDoc
# ----------------------------------------

# group (continued): Check and Delete
control_2 = CodeBlock(passthrough=get_link_doc, waitfor=unload_links) { [passthrough,waitfor][0]; }
delete_3 = Python(IN[0]=control_2)  # same code as delete
